test file "testman"
  setup callback:
    test = Simulink.Parameter(2);
    test.DataType = 'uint8';
  coverage: Decision, MCDC, Condition

suite "example"

  suite "example_Harness1"

    case "Group 1" [simulation]
      model example, harness example_Harness1

    case "Group 2" [simulation]
      model example, harness example_Harness1
      parameter set "Parameter Set 1": test = 10  % base workspace

    case "Group 3" [simulation]
      model example, harness example_Harness1
      parameter set "Parameter Set 1": test = 50  % base workspace